# Grasshopper definition builder_test.gh (Grasshopper 1.0.8)
# plug-ins: Selva

enable = BooleanToggle(True)
copy_up = BooleanToggle(False)
types = ValueList({"Sphere": 0, "Cylinder": 1, "Box": 2}, selected="Sphere")
radius = Slider(11, range=0..20)
heigth = Slider(10, range=10..20)
width = Slider(10, range=10..20)
ui_bridge = UIBridge(Enable=enable, Schema="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", SessionId="OkmqYprZ")

copy_up_2 = GetBoolean(copy_up, AtLeast=1, AtMost=1, FalseValue="False", TreeAccess=False, TrueValue="True")
radius_2 = GetNumber(radius, AtLeast=1, AtMost=1, Maximum=1.797693135e+308, Minimum=-1.797693135e+308, TreeAccess=False)
heigth_2 = GetNumber(heigth, AtLeast=1, AtMost=1, Maximum=1.797693135e+308, Minimum=-1.797693135e+308, TreeAccess=False)
width_2 = GetNumber(width, AtLeast=1, AtMost=1, Maximum=1.797693135e+308, Minimum=-1.797693135e+308, TreeAccess=False)
types_2 = GetValueList(
    types,
    AtLeast=1,
    AtMost=1,
    Immediate=True,
    StoredItems="""[
  {
    "name": "Sphere",
    "expression": "0"
  },
  {
    "name": "Cylinder",
    "expression": "1"
  },
  {
    "name": "Box",
    "expression": "2"
  }
]""",
    TreeAccess=False)

cylinder = Cylinder(Base=PlaneXY(0, 0, 0), Radius=radius_2, Length=width_2)
sphere = Sphere(Base=PlaneXY(0, 0, 0), Radius=radius_2)
center_box = CenterBox(Base=PlaneXY(0, 0, 0), X=radius_2, Y=heigth_2, Z=width_2)
cap_holes = CapHoles(Brep=cylinder)
stream_filter = StreamFilter(Gate=types_2, Stream0=sphere, Stream1=cap_holes, Stream2=center_box)
bounding_box = BoundingBox(Content=stream_filter, Plane=PlaneXY(0, 0, 0))  # -> Box, Box_2
deconstruct_box = DeconstructBox(Box=bounding_box.Box)  # -> Plane, X, Y, Z
unit_z = UnitZ(Factor=deconstruct_box.Z)
move = Move(Geometry=stream_filter, Motion=unit_z)  # -> Geometry, Transform
merge = Merge(Data1=stream_filter, Data2=move.Geometry)  # -> flatten(Result)
stream_filter_2 = StreamFilter(Gate=copy_up_2, Stream0=stream_filter, Stream1=merge)
three_material = ThreeMaterial(
    Color=ColourSwatch(SwatchColor=RGB(153, 116, 116)),
    Metalness=Slider(0.48, range=0..1),
    Roughness=0.5,
    Opacity=1,
    Transparent=False)
area = Area(Geometry=stream_filter_2)  # -> Area, Centroid
display = Display(Geo=stream_filter_2, ThreeMaterial=three_material)
geometry_to_file = GeometryToFile(Geometry=stream_filter_2, FileNames="Test", FileEnding=".3dm")
file = ContextBake(Content=geometry_to_file)
area_2 = ContextPrint(Text=area.Area)
display_2 = ContextBake(Content=display)
