# Grasshopper definition builder_test.gh (Grasshopper 1.0.8)
# plug-ins: ComputeBuilder, Compuceraptor

number_slider = Slider(10, range=0..100)
num_nu = GetNumber(Slider(12, range=0..20), AtLeast=1, AtMost=1, Maximum=100, Minimum=10, TreeAccess=False)
get_string = GetString("fgdffgdfg", AtLeast=1, AtMost=1, TreeAccess=False)
get_boolean = GetBoolean(AtLeast=1, AtMost=1, FalseValue="False", TreeAccess=False, TrueValue="True")
get_integer = GetInteger(AtLeast=1, AtMost=1, Maximum=2147483647, Minimum=-2147483648, TreeAccess=False)
ui_builder = UIBuilder(Enable=Toggle(False), Refresh=Button(), Schema="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", SessionId="0c87246f")  # -> SessionID, Info, Schema
panel = Panel(get_string)
panel_2 = Panel(get_boolean)
panel_3 = Panel(get_integer)
number = Number(num_nu)
addition = Addition(A=number, B=Slider(100, range=0..1000))
sphere = Sphere(Base=PlaneXY(0, 0, 0), Radius=num_nu)
schema = ContextPrint(Schema=ui_builder.Schema)
fgdf = ContextPrint(NumberOutput=addition)
display = Display(Geo=sphere)
context_bake = ContextBake(Content=display)
